% Simulink data dictionary B1Sup.sldd

TemperatureStatus = enum(DefaultValue="TEMP_HEALTH_OK")
  TEMP_HEALTH_OK = 0
  TEMP_HEALTH_DEGRADED = 1
  TEMP_HEALTH_CRITICAL = 2

BatteryStatus = enum(DefaultValue="BATTERY_HEALTH_OK")
  BATTERY_HEALTH_OK = 0
  BATTERY_HEALTH_DEGRADED = 1
  BATTERY_HEALTH_CRITICAL = 2

RxStatus = enum(DefaultValue="RX_OK")
  RX_OK = 0
  RX_DEGRADED = 1
  RX_CRITICAL = 2

SafetyStatus = enum(DefaultValue="SAFETY_OK")
  SAFETY_OK = 0
  SAFETY_DEGRADED = 1
  SAFETY_CRITICAL = 2

WheelStatus = enum(DefaultValue="WHEEL_OK")
  WHEEL_OK = 0
  WHEEL_DEGRADED_ENCODER = 1
  WHEEL_CRITICAL_MOTOR = 2

RxSnapshot_t = Simulink.Bus(DataScope="Imported", HeaderFile="snapshot/rx_snapshot.h")
  payload: Bus: CommPayloadB2_t
  last_event: Enum: CommUnpackStatus_t
  task_last_run_ms: uint32
  data_last_valid_ms: uint32

EncoderSnapshot_t = Simulink.Bus(DataScope="Imported", HeaderFile="snapshot/encoder_snapshot.h")
  wheel_speed_rpm: single[1 4]
  hasNoFeedback: boolean[1 4]
  task_last_run_ms: double
  data_last_valid_ms: double[1 4]

BoardHealthSnapshot_t = Simulink.Bus(DataScope="Imported", HeaderFile="snapshot/board_health_snapshot.h")
  temperature_degC: single
  battery_pct: single
  task_last_run_ms: uint32
  temp_last_valid_ms: uint32
  batt_last_valid_ms: uint32

SupervisorStatus = enum(DefaultValue="SUPERVISOR_OK")
  SUPERVISOR_OK = 0
  SUPERVISOR_DEGRADED = 1
  SUPERVISOR_CRITICAL = 2

SupervisorCommand_t = enum(DataScope="Imported", HeaderFile="shared_headers/supervisor_command.h", DefaultValue="CMD_NORMAL")
  CMD_NORMAL = 0
  CMD_ROTATE_180 = 1
  CMD_GO_LEFT = 2
  CMD_GO_RIGHT = 3
  CMD_AVOID_RIGHT = 4
  CMD_AVOID_LEFT = 5
  CMD_STOP = 6
  CMD_ESTOP = 7

CommPayloadB2_t = Simulink.Bus(DataScope="Imported", HeaderFile="shared_headers/comm_message_structures.h")
  command: Enum: SupervisorCommand_t
  degraded_mask: uint32
  critical_mask: uint32
  isMotionConsistent: boolean
  yaw: single
  x_norm: single
  y_norm: single
  btn1: uint8
  btn2: uint8
  alive_counter: uint32

CommUnpackStatus_t = enum(DataScope="Imported", HeaderFile="shared_headers/comm_status.h", DefaultValue="COMM_UNPACK_OK")
  COMM_UNPACK_OK = 0
  COMM_UNPACK_NULL = 1
  COMM_UNPACK_LEN = 2
  COMM_UNPACK_CRC = 3