% Simulink data dictionary B2Sup.sldd

SafetyStatus = enum(DefaultValue="SAFETY_OK")
  SAFETY_OK = 0
  SAFETY_DEGRADED = 1
  SAFETY_CRITICAL = 2

RxSnapshot_t = Simulink.Bus(DataScope="Imported", HeaderFile="snapshot/rx_snapshot.h")
  payload: Bus: CommPayloadB1_t
  last_event: Enum: CommUnpackStatus_t
  task_last_run_ms: uint32
  data_last_valid_ms: uint32

IMUSnapshot_t = Simulink.Bus(DataScope="Imported", HeaderFile="snapshot/imu_snapshot.h")
  task_last_run_ms: uint32
  data_last_valid_ms: uint32
  ax_g: single
  ay_g: single
  az_g: single
  gx_dps: single
  gy_dps: single
  gz_dps: single
  temperature_degC: single
  yaw: single

BleControllerSnapshot_t = Simulink.Bus(DataScope="Imported", HeaderFile="snapshot/ble_controller_snapshot.h")
  task_last_run_ms: uint32
  data_last_valid_ms: uint32
  ax_norm: single
  ay_norm: single
  bx_norm: single
  by_norm: single
  a_btn: uint8
  b_btn: uint8
  btn1: uint8
  btn2: uint8

ImuStatus = enum(DefaultValue="IMU_I2C_OK")
  IMU_I2C_OK = 0
  IMU_I2C_DEGRADED = 1
  IMU_I2C_CRITICAL = 2

SupervisorStatus = enum(DefaultValue="SUPERVISOR_OK")
  SUPERVISOR_OK = 0
  SUPERVISOR_DEGRADED = 1
  SUPERVISOR_CRITICAL = 2

RxStatus = enum(DefaultValue="RX_OK")
  RX_OK = 0
  RX_DEGRADED = 1
  RX_CRITICAL = 2

EspStatus = enum(DefaultValue="ESP_I2C_OK")
  ESP_I2C_OK = 0
  ESP_I2C_DEGRADED = 1
  ESP_I2C_CRITICAL = 2

SonarSnapshot_t = Simulink.Bus(DataScope="Imported", HeaderFile="snapshot/sonar_snapshot.h")
  dist_cm: uint16[1 3]
  task_last_run_ms: uint32
  data_last_valid_ms: uint32[1 3]

CommPayloadB1_t = Simulink.Bus(DataScope="Imported", HeaderFile="shared_headers/comm_message_structures.h")
  wheel_speed_rpm: single[1 4]
  degraded_mask: uint32
  critical_mask: uint32
  alive_counter: uint32

CommUnpackStatus_t = enum(DataScope="Imported", HeaderFile="shared_headers/comm_status.h", DefaultValue="COMM_UNPACK_OK")
  COMM_UNPACK_OK = 0
  COMM_UNPACK_NULL = 1
  COMM_UNPACK_LEN = 2
  COMM_UNPACK_CRC = 3

SupervisorCommand_t = enum(DataScope="Imported", HeaderFile="shared_headers/supervisor_command.h", DefaultValue="CMD_NORMAL")
  CMD_NORMAL = 0
  CMD_ROTATE_180 = 1
  CMD_GO_LEFT = 2
  CMD_GO_RIGHT = 3
  CMD_AVOID_RIGHT = 4
  CMD_AVOID_LEFT = 5
  CMD_STOP = 6
  CMD_ESTOP = 7